# Grasshopper definition Final.gh (Grasshopper 1.0.7)
# plug-ins: SpacePartition, Human, PTComponentLibrary, MetaHopper, SpaceSyntaxDesign_GH

# ---- group: InputData / Labels
txt = Text(Tree({0;0}: ["Unidades sanitarias mujeres / privadas"], {0;1}: ["Unidades sanitarias hombres / privadas"], {0;2}: ["Cuarto de aseo "], {0;3}: ["Área de aseo de residuos"], {0;4}: ["Almacen General Insumos de Aseo "], {0;5}: ["Área de UPC-Rack"]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))

# ---- group: InputData / Topology
int = Integer(Tree({0}: [7], {1}: [7], {2}: [3], {3}: [2, 11], {4}: [16, 21, 19], {5}: [19]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))

# ---- group: InputData / ID
txt_2 = Text(Tree({0;0}: ["5"], {0;1}: ["5"], {0;2}: ["5"], {0;3}: ["5"], {0;4}: ["5"], {0;5}: ["5"]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))

# ---- group: InputData / Areas
txt_3 = Text(Tree({0;0}: ["3"], {0;1}: ["3"], {0;2}: ["6"], {0;3}: ["1"], {0;4}: ["5"], {0;5}: ["4"]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))

# ---- group: InputData
number_slider = Slider(1, range=0..10)
path_mapper = PathMapper(txt, source="{A;B}", target="{A}")
path_mapper_2 = PathMapper(txt_3, source="{A;B}", target="{A}")
path_mapper_3 = PathMapper(int, source="{A;B}", target="{A}")
path_mapper_4 = PathMapper(txt_2, source="{A;B}", target="{A}")
prunebranches = CSharpScript(branches=path_mapper, howMany=number_slider)  # -> prunedTree, branchCounter; inputs branches: tree of String, howMany: Int32
# ---------- prunebranches: C# ----------
    var treeOut = new DataTree<string>();

    for( int i = 0; i < branches.BranchCount - howMany; ++i )
      treeOut.AddRange(branches.Branch(i), new GH_Path(i));

    prunedTree = treeOut;
    branchCounter = treeOut.BranchCount;
# ---------- end prunebranches ----------
prunebranches_2 = CSharpScript(branches=path_mapper_2, howMany=number_slider)  # -> prunedTree, branchCounter; inputs branches: tree of String, howMany: Int32; same code as prunebranches
ma = MassAddition(Input=prunebranches_2.prunedTree)  # -> Result, PartialResults
flatten = FlattenTree(Tree=prunebranches_2.prunedTree, Path="{0}")
lng = ListLength(List=flatten)
int_2 = Integer(Slider(4, range=0..10))

# ---- group: Grid / Controllers
number_slider_2 = Slider(20.818, range=0..21)
number_slider_3 = Slider(4.392, range=0..5)

# ---- group: Voronoi
number_slider_4 = Slider(0, range=0..0.1)
subtraction = Subtraction(A=Slider(1, range=0..1), B=number_slider_4)
dom = ConstructDomain(DomainStart=number_slider_4, DomainEnd=subtraction)

# ---- group: Grid
dom_2 = ConstructDomain(DomainStart=expr("-x", number_slider_2), DomainEnd=number_slider_2)
dom_3 = ConstructDomain(DomainStart=expr("-x", number_slider_3), DomainEnd=number_slider_3)
pt = Point(Point(-27.55069635, 0.2364199029, 0))
dedomain = DeconstructDomain(Domain=dom_2)  # -> Start, End
rectangle = Rectangle(Plane=pt, XSize=dom_3, YSize=dom_2, Radius=0)  # -> Rectangle, Length

# ----
genemodifier = GenePoolModifier(GeneList="SeedsX", Count=lng, Domain=dom, Randomize=Button(), PercentageOfRandomization=Slider(1, range=0..1))
genemodifier_2 = GenePoolModifier(GeneList="SeedsY", Count=lng, Domain=dom, Randomize=Button(), PercentageOfRandomization=Slider(1, range=0..1))

# ---- group: Labels
bang = ExplodeTree(Data=prunebranches.prunedTree)  # -> Branch0, Branch1, Branch2, Branch3

# ---- group: Areas
bang_2 = ExplodeTree(Data=prunebranches_2.prunedTree)  # -> Branch0, Branch1, Branch2, Branch3

# ---- group: SpacePartition / OriginalSilhouette
crv = Curve(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)

# ---- group: SpacePartition / RandomColourSeed
number_slider_5 = Slider(40, range=0..100)
number_slider_6 = Slider(238, range=0..1000)
number_slider_7 = Slider(326, range=0..1000)

# ---- group: SpacePartition
toggle = GroupToggle(ToggleActive=True, ToggleVisible=False)  # disabled
number_slider_8 = Slider(0.9, range=0..1)
subtraction_2 = Subtraction(A=Slider(1, range=0..1), B=number_slider_8)
lng_2 = ListLength(List=flatten(ma.Result))
dom_4 = ConstructDomain(DomainStart=subtraction_2, DomainEnd=number_slider_8)
lng_3 = ListLength(List=flatten(ma.Result))
dom_5 = ConstructDomain(DomainStart=0, DomainEnd=1)
genemodifier_3 = GenePoolModifier(GeneList="X", Count=lng_2, Domain=dom_4, Randomize=Button(), PercentageOfRandomization=Slider(1, range=0..1))
X = GenePool(Decimals=3, Maximum=0.9, Minimum=0.1, Value=[0.874, 0.19, 0.594, 0.124])
bbox = BoundingBox(Content=crv, Plane=PlaneXY(0, 0, 0))  # -> Box, Box_2
genemodifier_4 = GenePoolModifier(GeneList="Y", Count=lng_3, Domain=dom_4, Randomize=Button(), PercentageOfRandomization=Slider(1, range=0..1))
Y = GenePool(Decimals=3, Maximum=0.9, Minimum=0.1, Value=[0.159, 0.897, 0.115, 0.601])
ptsrfdomnum = SurfaceDomainNumber(Surface=bbox.Box, UNumber=Slider(2, range=0..100), VNumber=Slider(30, range=0..100))
pt_2 = ConstructPoint(XCoordinate=X, YCoordinate=Y, ZCoordinate=0)
ptborders = GenerateBorders(Grid=ptsrfdomnum, PanelShape=0)  # -> simplify(Border)
evalsrf = EvaluateSurface(Surface=reparameterize(crv), Point=pt_2)  # -> Point, Normal, UDirection, VDirection, Frame
crv_2 = Curve(flatten(ptborders))
item = ListItem(List=crv_2, Index=0, Wrap=True)
area = Area(Geometry=item)  # -> Area, Centroid
multiplication = Multiplication(A=area.Area, B=Slider(0.6, range=0..1))
lng_4 = ListLength(List=flatten(ma.Result))
dom_6 = ConstructDomain(DomainStart=Slider(13, range=0..21), DomainEnd=Slider(17, range=0..30))
srf_cp = SurfaceClosestPoint(Point=evalsrf.Point, Surface=crv)  # -> Point, UVPoint, Distance
voronoi = Voronoi(Points=srf_cp.Point, Boundary=rectangle.Rectangle, BruteForceOverride=False)
genemodifier_5 = GenePoolModifier(GeneList="R", Count=lng_4, Domain=dom_6, Randomize=Button(), PercentageOfRandomization=Slider(1, range=0..1))
R = GenePool(Decimals=3, Maximum=17, Minimum=13, Value=[15.163, 15.568, 15.164, 16.094])
number_slider_9 = Slider(0.001, range=0..0.001)
scale = Scale(Geometry=rectangle.Rectangle, Center=pt, Factor=Slider(3, range=0..10))  # -> Geometry, Transform
multiplication_2 = Multiplication(A=multiplication, B=Slider(2.8, range=0..10))
w_voronoi = WeightedVoronoi(BasePlane=PlaneXY(0, 0, 0), Points=srf_cp.Point, Radii=R, BoundingCurve=scale.Geometry)  # -> AdjacencyGraph, VoronoiCells
crv_3 = Curve(w_voronoi.VoronoiCells)
dom_7 = ConstructDomain(DomainStart=Slider(0, range=0..100), DomainEnd=Slider(255, range=0..1000))
number_slider_10 = Slider(241, range=0..255)

# ----
spacepartition = SpacePartition(VoronoiIn=crv_3, GridIn=crv_2, AreaIn=multiplication, Distance=multiplication_2)

# ---- group: SpacePartition (continued)
sortxy = SortPointsXY(Grid=flatten(spacepartition))
pararunion = ParallelRegionUnion(Curves=spacepartition)
missing = MissingGridCells(CulledGrid=flatten(sortxy), OriginalGrid=crv_2)
mgtree = MergeTreeMissing(CulledGrid=pararunion, MissingGridCells=missing)
pararunion_2 = ParallelRegionUnion(Curves=mgtree)
parallelregionintersection = ParallelRegionIntersection(CurvesA=crv, CurvesB=pararunion_2)
lng_5 = ListLength(List=flatten(parallelregionintersection))
random = Random(Range=dom_7, Number=lng_5, Seed=[number_slider_5, number_slider_6, number_slider_7], Integers=True)
bang_3 = ExplodeTree(Data=random)  # -> Branch0, Branch1, Branch2
srf = Surface(parallelregionintersection)
rgb = ColourRGB(Alpha=Slider(10, range=0..10), Red=bang_3.Branch0, Green=bang_3.Branch1, Blue=bang_3.Branch2)
rgb_2 = ColourRGB(
    Alpha=number_slider_10,
    Red=bang_3.Branch0,
    Green=[55, 209, 59, 216, 1, 112, 142, 1, 76, 111, 92, 58, 62, 60, 197, 158, 67, 19, 183, 163, 50, 202, 112, 182, 111],
    Blue=[9, 120, 163, 36, 100, 115, 248, 253, 79, 124, 119, 250, 189, 19, 44, 159, 229, 29, 128, 139, 34, 211, 22, 234, 166])
preview = CustomPreview(Geometry=graft(crv_3), Material=graft(rgb))

# ---- group: Geometry
bang_4 = ExplodeTree(Data=simplify(parallelregionintersection))  # -> Branch0, Branch1, Branch2, Branch3

# ----
rgb_3 = ColourRGB(Alpha=number_slider_10, Red=expr("x*2", bang_3.Branch1), Green=expr("x*0.5", bang_3.Branch1), Blue=0)

# ---- group: SpacePartition (continued)
preview_2 = CustomPreview(Geometry=srf, Material=graft(rgb_3))

# ---- group: OptimizationAndLabeling
labels = Panel("""PrivadoUno
Publico
PrivadoDos
SemiPrivado""")
area_2 = Area(Geometry=parallelregionintersection)  # -> Area, Centroid
lng_6 = ListLength(List=labels)
dom_8 = ConstructDomain(DomainStart=0, DomainEnd=Slider(30, range=0..100))
pt_3 = Point(Point(-29.85498097, -20.27765421, 0))
genemodifier_6 = GenePoolModifier(GeneList="DistanceList", Count=lng_6, Domain=dom_8, Randomize=Button(), PercentageOfRandomization=Slider(1, range=0..1))
distancelist = GenePool(Decimals=2, Maximum=30, Minimum=0, Value=[21.04, 0, 20.15, 0])
sort = SortList(Keys=flatten(ma.Result), ValuesA=flatten(ma.Result))  # -> Keys, ValuesA
multiplication_3 = Multiplication(A=flatten(area_2.Area), B=0.7)
galapagos = Galapagos(fitness=c_script, gene=[Y, R, X])
c_script = CSharpScript(
    x=multiplication_3,
    y=flatten(sort.Keys),
    z=flatten(area_2.Centroid),
    u=pt_3,
    v=distancelist,
    w=Slider(3, range=0..10),
    xx=Button())  # -> out, A; inputs x: list, y: list, z: list, v: list
# ---------- c_script: C# ----------
    double total = 0;
    double mult = (double) w;

    /*var document = Component.OnPingDocument();

    if( document.IsModified )
    {

      counter++;

    }

    if( (bool) xx == true )

      counter = 0;
*/
    if( x.Count != y.Count )
    {

      total = 1000;

    }

    else
    {

      for( int i = 0; i < x.Count; ++i )
      {

        total += Math.Abs(Convert.ToDouble(x[i]) - Convert.ToDouble(y[i]));
        var point = (Point3d) z[i];
        double tempDistance = point.DistanceTo(( Point3d ) u);

        switch( i )
        {

          case 0:

            tempDistance = mult * Math.Abs(tempDistance - (double) v[0]);

            break;

          case 1:

            tempDistance = mult * Math.Abs(tempDistance - (double) v[1]);

            break;

          case 2:

            tempDistance = mult * Math.Abs(tempDistance - (double) v[2]);

            break;

          case 3:

            tempDistance = mult * Math.Abs(tempDistance - (double) v[3]);

            break;

        }

        total += tempDistance;

      }

    }

    A = total;
    //Print("Number of Iterations: {0}", counter);
# ---------- c_script: C# additional code ----------
  //int counter = 0;
# ---------- end c_script ----------
division = Division(A=multiplication_3, B=sort.Keys)
graft = GraftTree(Tree=labels, IncludeEmptyLists=True, IncludeNullItems=True)  # -> simplify(Tree)
errorpercentage = Panel(division)
ma_2 = MassAddition(Input=division)  # -> Result, PartialResults
lng_7 = ListLength(List=division)
addindextolabels = CSharpScript(labels=graft, areas=flatten(multiplication_3))  # -> indexedLabels; inputs labels: tree, areas: list
# ---------- addindextolabels: C# ----------
    var newLabels = new DataTree<string>();

    for( int i = 0; i < labels.BranchCount; ++i )
      for( int j = 0; j < labels.Branch(i).Count; ++j )
      {

        newLabels.Add((string)labels.Branch(i)[j] + ' ' + Math.Round(( double ) areas[i], 3), new GH_Path(i));

      }

    indexedLabels = newLabels;
# ---------- end addindextolabels ----------
division_2 = Division(A=ma_2.Result, B=lng_7)
subtraction_3 = Subtraction(A=Slider(1, range=0..1), B=division_2)
results = Panel(multiplication_3)
errorpercentagemean = Panel(subtraction_3)
expectedresults = Panel(sort.Keys)
screentext = ScreenOrientedText(
    Text=addindextolabels,
    Font="Interstate",
    Justification=8,
    Location=graft(area_2.Centroid),
    SizeFactor=Slider(6.961, range=0..100),
    Color=RGB(255, 255, 255),
    Depth=0,
    Absolute=False)

# ---- group: SpaceSyntaxis
spctopo = SpaceTopology(Curves=flatten(parallelregionintersection), ParallelComputing=Toggle(False))
linetopo = LineTopology(PointTree=area_2.Centroid, Topology=spctopo)
ma_3 = MassAddition(Input=multiplication_3)  # -> Result, PartialResults
news_graph = GraphFromNodesLinksWithNEWS(Points=flatten(area_2.Centroid), Links=flatten(linetopo), Labels=labels, Areas=multiplication_3, TotalArea=ma_3.Result)  # -> Graph, GraphVertices, Attributes
diskograph = DiskoGraphDrawing(
    Plane=PlaneXY(0, 0, 0),
    Graph=spctopo,
    Vertices=simplify(news_graph.GraphVertices),
    Attributes=news_graph.Attributes,
    Thickness=1)

# ----
panel = Panel(c_script.A)
