# Grasshopper definition FloorPlanGHOne.gh (Grasshopper 1.0.7)
# plug-ins: treesloth01

text = Text(Tree({1}: ["Área de control vehicular - Vigilancia", "1", "1.5", "1.5", "1"], {2}: ["Parqueaderos vehicular (5,00 x 2,50 mts)", "5", "12.5", "62.5", "1"], {3}: ["Parqueaderos discapacitados (5,00 x 3,70 mts)", "1", "18.5", "18.5", "1"], {4}: ["Parqueaderos bicicletas/motos", "5", "1.2", "6", "1"], {5}: ["Zona de Parqueo ambulancias", "1", "11", "11", "1"], {6}: ["*", "*", "*", "*", ""]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))
partitiontreeatchar = CSharpScript(data=text, erase="*")  # -> A; inputs data: tree of String, erase: String
# ---------- partitiontreeatchar: C# ----------
    var treeOut = new DataTree<string>();
    int path = 0;

    for( int i = 0; i < data.BranchCount; ++i )
      for( int j = 0; j < data.Branch(i).Count; ++j )
      {

        if( data.Branch(i)[j] != erase )
        {

          treeOut.Add(data.Branch(i)[j], new GH_Path(path));
          //path++;

        }
        
        else
        {
        
          path++;
        
        }

      }

    A = treeOut;
# ---------- end partitiontreeatchar ----------
cleantreefromempty = CSharpScript(data=partitiontreeatchar)  # -> A; inputs data: tree of String
# ---------- cleantreefromempty: C# ----------
    var treeOut = new DataTree<string>();

    foreach( var path in data.Paths )
    {
    
      var branch = data.Branch(path);
      
      foreach( var item in branch )
      {
      
        if( !String.IsNullOrEmpty(item) )
        treeOut.Add( item, path );
      
      }
    
    }

    A = treeOut;
# ---------- end cleantreefromempty ----------
gene_pool = GenePool(
    Decimals=2,
    Maximum=1,
    Minimum=0,
    Value=[0.9721691734, 0.3940420111, 0.09806669741, 0.4963137491, 0.6310349347, 0.2720474639, 0.3445372346, 0.4332898257, 0.9109802972, 0.3605328451, 0.04228328683, 0.3170308351, 0.4941467589, 0.7783018154, 0.6591811323, 0.8372587323, 0.4461596475, 0.4614113264, 0.1973582023, 0.807767244, 0.08734677596, 0.6416664811, 0.7506823501])
gene_pool_2 = GenePool(
    Decimals=2,
    Maximum=1,
    Minimum=0,
    Value=[0.1259618253, 0.9086043899, 0.4475464623, 0.06254124318, 0.0382319363, 0.3048866644, 0.46501961, 0.5126458074, 0.8089686771, 0.9566153348, 0.5946551625, 0.3352268419, 0.3276468219, 0.3207489915, 0.09939579344, 0.944163356, 0.7091837012, 0.9599813167, 0.7219291915, 0.6181423513, 0.4372404979, 0.9821487772, 0.8863293561])
curve = Curve(<curve referenced from the Rhino model>)
renumber_paths = RenumberPaths(Data=cleantreefromempty)
construct_point = ConstructPoint(XCoordinate=gene_pool, YCoordinate=gene_pool_2, ZCoordinate=0)
surface = Surface(reparameterize(curve))
evaluate_surface = EvaluateSurface(Surface=surface, Point=construct_point)  # -> Point, Normal, UDirection, VDirection, Frame
cullbranchesfromindex = CSharpScript(branches=renumber_paths, cullFrom=Slider(4, range=0..10))  # -> out, treeOut; inputs branches: tree of String, cullFrom: Int32
# ---------- cullbranchesfromindex: C# ----------
    var newTree = new DataTree<string>();

    for( int i = 0; i < branches.BranchCount; ++i )
    {

      var path = branches.Path(i);

      if( path.Indices[0] >= cullFrom )

        newTree.AddRange(branches.Branch(i), path);

    }

    treeOut = newTree;
# ---------- end cullbranchesfromindex ----------
point = Point(evaluate_surface.Point)
renumber_paths_2 = RenumberPaths(Data=cullbranchesfromindex.treeOut)
voronoi = Voronoi(Points=point, BruteForceOverride=False)  # disabled
partition_list = PartitionList(List=renumber_paths_2, Size=Slider(5, range=0..10))
region_intersection = RegionIntersection(CurvesA=voronoi, CurvesB=curve)  # disabled
gene_pool_3 = GenePool(
    Decimals=2,
    Maximum=10,
    Minimum=5,
    Value=[6.458042304, 7.55139517, 10, 9.57, 9.912531692, 8.549085685, 5.011922529, 7.160544094, 7.563966537, 6.368715224, 8.816543831, 5.256130067, 9.643263635, 5.249789318, 9.505874144, 9.401475696, 9.469663182, 6.624038418, 7.865591523, 7.923628768, 7.448701846, 7.136769703, 8.79])
text_2 = Text(partition_list)
discontinuity = Discontinuity(Curve=region_intersection, Level=1)  # -> Points, Parameters; disabled
list_item = ListItem(List=text_2, Index=Slider(2, range=0..3), Wrap=True)
circle_fit = CircleFit(Points=discontinuity.Points)  # -> Circle, Radius, Deviation; disabled
number_slider = Slider(51, range=0..100)
multiplication = Multiplication(A=gene_pool_3, B=Slider(0.5, range=0..1))
construct_domain = ConstructDomain(DomainStart=expr("-x", multiplication), DomainEnd=multiplication)  # -> flatten(Domain)
multiplication_2 = Multiplication(A=list_item, B=Slider(0.2, range=0..1))
rectangle = Rectangle(Plane=PlaneXY(0, 0, 0), XSize=number_slider, YSize=number_slider, Radius=0)  # -> Rectangle, Length
rectangle_2 = Rectangle(Plane=point, XSize=construct_domain, YSize=construct_domain, Radius=0)  # -> Rectangle, Length
construct_domain_2 = ConstructDomain(DomainStart=expr("-x", multiplication_2), DomainEnd=multiplication_2)  # -> flatten(Domain)
region_intersection_2 = RegionIntersection(CurvesA=rectangle_2.Rectangle, CurvesB=curve)
curve_2 = Curve(region_intersection_2)
collision_many_many = CollisionManyMany(Colliders=curve_2)  # -> Collision, Indices
list_length = ListLength(List=region_intersection_2)
area = Area(Geometry=region_intersection_2, UseTasks=False)  # -> Area, Centroid
random = Random(Range=Domain(0, 1), Number=list_length, Seed=Slider(1000, range=0..1000))
random_2 = Random(Range=Domain(0, 1), Number=list_length, Seed=Slider(626, range=0..1000))
mass_addition = MassAddition(Input=collision_many_many.Collision)  # -> Result, PartialResults
random_3 = Random(Range=Domain(0, 1), Number=list_length, Seed=Slider(482, range=0..1000))
mass_addition_2 = MassAddition(Input=area.Area)  # -> Result, PartialResults
panel = Panel(mass_addition.Result)
colour_rgb_f = ColourRGBF(Alpha=1, Red=random, Green=random_2, Blue=random_3)
surface_2 = Surface(region_intersection_2)
panel_2 = Panel(mass_addition_2.Result)
custom_preview = CustomPreview(Geometry=surface_2, Material=colour_rgb_f)
galapagos = Galapagos(fitness=addition, gene=[gene_pool, gene_pool_2])
expression = Expression(x=mass_addition.Result, z=Slider(1, range=0..100), Expression="If( x < z, 0, 10000 )")
expression_2 = Expression(
    x=mass_addition_2.Result,
    y=Slider(320, range=0..1000),
    z=Slider(300, range=0..1000),
    Expression="If( ( x < y) And ( x > z), 0, 1000 )")
addition = Addition(A=expression_2, B=expression)
panel_3 = Panel(addition)
