# Grasshopper definition PhysicsPacking.gh (Grasshopper 1.0.7)
# plug-ins: SpacePartition, PTComponentLibrary, Kangaroo2 Components

number_slider = Slider(21, range=0..21)
number_slider_2 = Slider(5, range=0..5)
number_slider_3 = Slider(0.1, range=0..0.1)
dom = ConstructDomain(DomainStart=expr("-x", number_slider), DomainEnd=number_slider)
dom_2 = ConstructDomain(DomainStart=expr("-x", number_slider_2), DomainEnd=number_slider_2)
subtraction = Subtraction(A=Slider(1, range=0..1), B=number_slider_3)
toggle = BooleanToggle(True)
number_slider_4 = Slider(25, range=0..100)
toggle_2 = BooleanToggle(True)
dom_3 = ConstructDomain(DomainStart=number_slider_3, DomainEnd=subtraction)
genemodifier = GenePoolModifier(
    GeneList="PointsX",
    Count=number_slider_4,
    Domain=dom_3,
    Randomize=Button(),
    PercentageOfRandomization=Slider(1, range=0..1))
genemodifier_2 = GenePoolModifier(
    GeneList="PointsY",
    Count=number_slider_4,
    Domain=dom_3,
    Randomize=Button(),
    PercentageOfRandomization=Slider(1, range=0..1))
toggle_3 = BooleanToggle(True)
pointsx = GenePool(
    Decimals=2,
    Maximum=0.9,
    Minimum=0.1,
    Value=[0.1869033602, 0.1084055498, 0.3330265471, 0.4587887486, 0.302431189, 0.8965586368, 0.8492906373, 0.5143991904, 0.43080819, 0.6355596217, 0.8532898403, 0.2092844636, 0.8166597563, 0.8792622331, 0.7667291719, 0.2538228807, 0.4938209956, 0.6479328557, 0.7504073548, 0.192521298, 0.4218760272, 0.6190212353, 0.5099908477, 0.3580680867, 0.2905723383])
pointsy = GenePool(
    Decimals=2,
    Maximum=0.9,
    Minimum=0.1,
    Value=[0.2140706678, 0.785285598, 0.4417914534, 0.3640028862, 0.6467992394, 0.508041917, 0.5183068628, 0.5791312604, 0.8010340224, 0.8055068939, 0.6000262572, 0.1558724597, 0.3731355065, 0.4406143689, 0.1917650991, 0.7119934506, 0.3558582557, 0.1298343521, 0.4730765937, 0.3980475874, 0.547841611, 0.7583091225, 0.1009966955, 0.6701648909, 0.4575501336])
rectangle = Rectangle(Plane=PlaneXY(0, 0, 0), XSize=dom_2, YSize=dom, Radius=0)  # -> Rectangle, Length
offset = OffsetCurve(Curve=rectangle.Rectangle, Distance=1, Plane=PlaneXY(0, 0, 0), Corners=1)
dom_4 = ConstructDomain(DomainStart=Slider(0.7, range=0..1), DomainEnd=Slider(1.5, range=0..10))
offset_2 = OffsetCurve(Curve=rectangle.Rectangle, Distance=Slider(10, range=0..10), Plane=PlaneXY(0, 0, 0), Corners=1)
loft = Loft(
    Curves=flatten([offset, rectangle.Rectangle]),
    Options={Adjust=False, Closed=False, LoftEnds=0, LoftSimp=0, LoftType=0, Rebuild=10, Refit=0.01})
genemodifier_3 = GenePoolModifier(GeneList="R", Count=number_slider_4, Domain=dom_4, Randomize=Button(), PercentageOfRandomization=Slider(1, range=0..1))
crv = Curve(rectangle.Rectangle)
debrep = DeconstructBrep(Brep=loft)  # -> Faces, Edges, Vertices
loft_2 = Loft(
    Curves=flatten([offset_2, rectangle.Rectangle]),
    Options={Adjust=False, Closed=False, LoftEnds=0, LoftSimp=0, LoftType=0, Rebuild=10, Refit=0.01})
pt = ConstructPoint(XCoordinate=pointsx, YCoordinate=pointsy, ZCoordinate=0)
debrep_2 = DeconstructBrep(Brep=loft_2)  # -> Faces, Edges, Vertices
division = Division(A=number_slider, B=Slider(4, range=0..10))
division_2 = Division(A=number_slider_2, B=Slider(1, range=0..10))
join = JoinCurves(Curves=debrep.Edges, Preserve=False)
evalsrf = EvaluateSurface(Surface=reparameterize(rectangle.Rectangle), Point=pt)  # -> Point, Normal, UDirection, VDirection, Frame
num = Number(0.7853981634)
wires = BrepWireframe(Brep=debrep_2.Faces, Density=-1)
genes = GenePool(Decimals=2, Maximum=1, Minimum=0, Value=[0.446889722, 0.7792427059, 0.7646553892, 0.5137594321])
ptsrfdomlen = SurfaceDomainLength(Surface=crv, ULength=division_2, VLength=division)
multiplication = Multiplication(B=num)
subtraction_2 = Subtraction(B=multiplication)
genes_2 = GenePool(Decimals=2, Maximum=1, Minimum=0, Value=[0.06304590454, 0.2180554607, 0.6773533866, 0.1066206256])
join_2 = JoinCurves(Curves=wires, Preserve=False)  # -> flatten(Curves)
disc = Discontinuity(Curve=rectangle.Rectangle, Level=1)  # -> Points, Parameters
pt_2 = ConstructPoint(XCoordinate=genes_2, YCoordinate=genes, ZCoordinate=0)
shatter = Shatter(Curve=rectangle.Rectangle, Parameters=disc.Parameters, UseTasks=False)
number_slider_5 = Slider(3, range=0..10)
number_slider_6 = Slider(0.0001, range=0..0.0001)
ptborders = GenerateBorders(Grid=ptsrfdomlen, PanelShape=0)  # -> simplify(flatten(Border))
pt_3 = Point(Point(0.1972422913, -0.1375651247, 0))
evalsrf_2 = EvaluateSurface(Surface=reparameterize(rectangle.Rectangle), Point=pt_2)  # -> Point, Normal, UDirection, VDirection, Frame
vec2pt = Vector2Pt(PointA=evalsrf.Point, PointB=pt_3, Unitize=False)  # -> Vector, Length
Y = UnitY(Factor=expr("-x", Slider(0.001, range=0..1)))
rev = Reverse(Vector=vec2pt.Vector)
voronoi = Voronoi(Points=evalsrf_2.Point, Boundary=rectangle.Rectangle, BruteForceOverride=False)
grab = Grab(On=True, Strength=1, Range=3)
item = ListItem(List=ptborders, Index=0, Wrap=True)
load = Load(Point=evalsrf.Point, ForceVector=Y, Weighting=1)
threshold = Threshold(1e-15)
R = GenePool(
    Decimals=2,
    Maximum=1.5,
    Minimum=0.7,
    Value=[0.9481513676, 1.013555057, 1.461188467, 0.7730449055, 1.458051151, 1.105441878, 1.184234606, 1.017922009, 1.413533544, 1.30280958, 1.282055623, 0.837396573, 0.7419895239, 1.148859104, 1.105347279, 0.72880526, 1.263982446, 1.103598852, 0.7900945612, 1.452354161, 0.8904358965, 0.803092235, 0.9533103724, 0.8996122208, 1.177074982])
area = Area(Geometry=item, UseTasks=False)  # -> Area, Centroid
num_2 = Number(flatten(Tree({0}: [3, 3, 6, 1, 5, 4, 5, 6, 6, 5], {1}: [15, 12], {2}: [6, 4, 12, 9, 4, 4, 4], {3}: [48, 24, 24, 12, 6, 5])))
amp = Amplitude(Vector=vec2pt.Vector, Amplitude=Slider(0.001, range=0..1))
load_2 = Load(Point=evalsrf.Point, ForceVector=amp, Weighting=1)
multiplication_2 = Multiplication(A=area.Area, B=0.6)
plasticanchor = PlasticAnchor(Point=evalsrf.Point, Limit=0.001, Strength=Slider(0.1, range=0..1))  # disabled
spacepartition = SpacePartition(VoronoiIn=voronoi, GridIn=ptborders, AreaIn=multiplication_2, Tolerance=Slider(0.001, range=0..0.001))
sqrt = SquareRoot(Value=num_2)
sortxy = SortPointsXY(Grid=flatten(spacepartition))
multiplication_3 = Multiplication(A=sqrt, B=R)
division_3 = Division(A=num_2, B=multiplication_3)
construct_domain = ConstructDomain(DomainStart=Slider(0, range=0..100), DomainEnd=Slider(255, range=0..1000))
missing = MissingGridCells(CulledGrid=sortxy, OriginalGrid=ptborders)
pararunion = ParallelRegionUnion(Curves=spacepartition)
colours = GenePool(Decimals=0, Maximum=255, Minimum=0, Value=[17.0001572, 159, 85])
multiplication_4 = Multiplication(A=division_3, B=0.5)
multiplication_5 = Multiplication(A=multiplication_3, B=0.5)
mgtree = MergeTreeMissing(CulledGrid=pararunion, MissingGridCells=missing)
dom_5 = ConstructDomain(DomainStart=expr("-x", multiplication_4), DomainEnd=multiplication_4)
dom_6 = ConstructDomain(DomainStart=expr("-x", multiplication_5), DomainEnd=multiplication_5)
pararunion_2 = ParallelRegionUnion(Curves=mgtree)
list_length = ListLength(List=flatten(pararunion_2))
random = Random(Range=construct_domain, Number=list_length, Seed=colours, Integers=True)
rectangle_2 = Rectangle(Plane=evalsrf.Point, XSize=dom_6, YSize=dom_5, Radius=0)  # -> Rectangle, Length
cc = CurveCollide(Curves=rectangle_2.Rectangle, Frames=evalsrf.Frame, PassiveCurves=join_2, BasePlane=PlaneXY(0, 0, 0), Strength=1)  # -> Goal, Frames
solver = Solver(GoalObjects=[cc.Goal, load], Reset=Button(), Threshold=threshold, Tolerance=0.01, On=Toggle(False))  # -> I, V, O; disabled
clean = CleanTree(RemoveNulls=True, RemoveInvalid=True, RemoveEmpty=False, Tree=solver.O)
zombiesolver = ZombieSolver(GoalObjects=cc.Goal, Threshold=1e-10, Tolerance=0.01, MaxIterations=Slider(500, range=0..10000))  # -> I, V, O; disabled
c_script = CSharpScript(x=zombiesolver.O)  # -> A; inputs x: list
# ---------- c_script: C# ----------
    A = x[0];
# ---------- end c_script ----------
explode_tree = ExplodeTree(Data=random)  # -> Branch0, Branch1, Branch2
colour_rgb = ColourRGB(Alpha=Slider(255, range=0..255), Red=explode_tree.Branch0, Green=explode_tree.Branch1, Blue=explode_tree.Branch2)
srf = Surface(simplify(pararunion_2))
custom_preview = CustomPreview(Geometry=srf, Material=graft(colour_rgb))
